vi "Simple.gvi"   [LabVIEW NXG 2.1.0]
panel controls:
  "input 0": f64
  "input 1": f64
  "input 1_2": f64
panel indicators:
  "Output": i32
diagram:
  Multiply($"input 0", $"input 1") -> w1
  Multiply(w1, $"input 1_2") -> w2
  Is Greater Than 0(x=w2) -> w3
  case (w3) {
    frame False, Default {
      # TODO:Fill in code
      w4 = default
    }
    frame True {
      To Byte Integer(number=w1) -> w5
      In Range And Coerce(lower limit=0, upper limit=100, x=w5) -> (coerced(x)=w6)
      for (N = w6) (iteration -> i1) {
        append i1 to w7
      }
      Add Array Elements(numeric array=w7) -> (sum=w4)
    }
  }
  $Output <- w4
